# Grasshopper definition magpie-results-generator.gh (Grasshopper 0.9.76)
# plug-ins: MechanoAdaptiveGeneration

# ----
# Use Magpie out of the box
# Explanation of options: long axis numerator
# long axis denominator
# minimum anisotropy ratio
# align strength
# plastic drag distance
mesh = Mesh(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)  # disabled
box_fixed_point_indices = Integer([4, 5, 7, 11, 14, 16, 17, 18])  # disabled
data_60x10x20 = Data([-0.319583, -0.045, 0.005, -0.999062, 1.104184, -11.002075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])  # disabled
demesh = DeconstructMesh(Mesh=mesh)  # -> Vertices, Faces, Colours, Normals; disabled
item = ListItem(List=demesh.Vertices, Index=box_fixed_point_indices, Wrap=True)  # disabled
pt = Point(item)  # disabled
volume_factor = Slider(0.9, range=0..2)  # disabled
pop3d = Populate3D(Region=mesh, Count=1000, Seed=1)  # disabled
options = Panel("""0.5
1
0.5
15000
0.001""")  # disabled
entwine = Entwine(Branch00=pt, Branch01=pop3d, FlattenInputs=True)  # -> flatten(Result); disabled
path = FilePath("S:\04_Development\Magpie-beta\magpie-example-results\result-of-compiled-magpie.txt")  # disabled
save = Button()  # disabled
reset = Button()  # disabled
toggle = BooleanToggle(True)  # disabled
timer = Timer(TimerInterval=50, Target=generate)  # disabled
saved_file_location = Panel(path)  # disabled
generate = MechanoAdaptiveGeneration(
    Save=save,
    Rst=reset,
    R=toggle,
    M=mesh,
    P=entwine,
    D=data_60x10x20,
    FP=[0, 1, 2, 3, 4, 5, 6, 7],
    O=options,
    VF=volume_factor,
    file=path)  # -> EllipsoidCentres, LongAxes, ShortAxes, PercentVolumePacked, Iterations, Lines, Bake, RecentErrors; disabled
visualiseellipsoids = VisualiseEllipsoids(pts=generate.EllipsoidCentres, longaxes=generate.LongAxes, shortaxes=generate.ShortAxes)  # disabled
line = Line(generate.Lines)  # disabled
latest_median_distances = Panel(generate.RecentErrors)  # disabled
colourful = Colourful(geo=visualiseellipsoids)  # disabled

# ----
# Use Magpie from a script
mesh_2 = Mesh(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)  # disabled
box_fixed_point_indices_2 = Integer([4, 5, 7, 11, 14, 16, 17, 18])  # disabled
data_60x10x20_2 = Data([-0.319583, -0.045, 0.005, -0.999062, 1.104184, -11.002075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])  # disabled
demesh_2 = DeconstructMesh(Mesh=mesh_2)  # -> Vertices, Faces, Colours, Normals; disabled
item_2 = ListItem(List=demesh_2.Vertices, Index=box_fixed_point_indices_2, Wrap=True)  # disabled
pt_2 = Point(item_2)  # disabled
reset_2 = Button()
step = BooleanToggle(True)
timer_2 = Timer(TimerInterval=50, Target=example_script_for_magpie)  # disabled
example_script_for_magpie = CSharpScript(
    RESET=reset_2,
    STEP=step,
    M=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,
    D=[-0.319583, -0.045, 0.005, -0.999062, 1.104184, -11.002075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],
    FP=[4, 5, 7, 11, 14, 16, 17, 18],
    Reference="C:\Users\afelder\Documents\Test-out-of-the-box\MechanoAdaptiveGeneration-master\src\MechanoAdaptiveGeneration\bin\MechanoAdaptiveGeneration.dll")  # -> out, centres, LA, SA, Lines, maxLength, averageLength, minLength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; inputs RESET: Boolean, STEP: Boolean, M: Mesh, S: Mesh, D: list of Double, FP: list of Int32
# ---------- example_script_for_magpie: C# ----------
    if(RESET)
    {
      //set user-defined initial parameters
      round = 0;
      minLA = 1.0;
      maxLA = 1.0;
      minSlender = 1.0;
      double plasticDragDist = 0.001;
      double volumeFactor = 0.9;
      double alignStrength = 0;
      double boundaryCollideStrength = 1e8;
      int maxIterations = 1500;
      bool updateScale = true;
      nParticles = 1000;

      //set up for trying several solutions
      foundValidSolution = false;
      numberOfTestedSolutions = 0;
      seed = 91;
      tryNextSolution = false;

      //initialize ellipsoid centres randomly, but add some of the mesh vertices as fixed first
      List < Point3d > P = new List<Point3d>();
      P.Add(M.Vertices[4]);
      P.Add(M.Vertices[5]);
      P.Add(M.Vertices[7]);
      P.Add(M.Vertices[11]);
      P.Add(M.Vertices[14]);
      P.Add(M.Vertices[16]);
      P.Add(M.Vertices[17]);
      P.Add(M.Vertices[18]);
      P.AddRange(populateMesh(M, nParticles, seed));

      //create an instance of Magpie and pass user-defined parameters grouped into categories to it
      Gen = new MechanoAdaptiveGeneration.Generator();
      ACP = new AlgorithmConvergenceParameters(volumeFactor, maxIterations, updateScale);
      IGP = new InputGeometryParameters(M, S, P, D);
      KGP = new KangarooGoalParameters(plasticDragDist, boundaryCollideStrength, alignStrength, new List<int>{0,1,2,3,4,5,6,7});
      EP = new EllipsoidParameters(minLA, maxLA, minSlender);
      Gen.Initialize(IGP, KGP, EP, ACP);
    }

    if(STEP)
    {
      if(!foundValidSolution)
      {
        bool converged = false;
        if(tryNextSolution)
        {
          List<Point3d> P = populateMesh(M, nParticles, seed);
          //update anisotropy and size for next simulation
          KGP.alignStrength += 1000;
          //if current round has ended, initialize next round
          if(KGP.alignStrength > 16000)
          {
            round++;
            KGP.alignStrength = 0.0;
            if(round == 1 || round == 3)
            {
              minLA = 0.5;
            }
            else{
              minLA = 1.0;
            }
            if(round >= 2)
            {
              minSlender = 0.5;
            }
          }

          EP = new EllipsoidParameters(minLA, maxLA, minSlender);

          //convergence data hase to be reset at the beginning of every run!
          ACP = new AlgorithmConvergenceParameters(ACP.volumeFactor, ACP.maxIterations, ACP.updateScale);
          ACP.iterations = 0;
          ACP.isConverged = false;
          tryNextSolution = false;


          Gen.Initialize(IGP, KGP, EP, ACP);
        }

        if(!Gen.IsConverged()){
          Gen.Step(KGP, EP, ACP);
        }

        converged = Gen.IsConverged();
        if(converged)
        {
          Print("converged\n");
          if (round > 3)
          {
            foundValidSolution = true;
          }
          else
          {
            //write results to file
            tryNextSolution = true;
            results = new MagpieResults();
            results.acp = Gen.GetACP();
            results.ep = Gen.GetEP();
            results.igp = Gen.GetIGP();
            results.kgp = Gen.GetKGP();
            results.iterations = Gen.GetCount();
            results.converged = Gen.IsConverged();
            results.paramsUnchangedDuringPacking = true;
            results.magpieVersion = "1.0.0-beta-final";
            results.packing = new EllipsoidPacking(Gen.GetCentres(), Gen.GetLongAxes(), Gen.GetShortAxes());
            results.collisionLines = Gen.GetLines();
            MagpieWriter writer = new MagpieWriter();
            Print("Starting to write to C:/Users/afelder/Desktop/final/final-result-with-anisotropy-" + minSlender.ToString() + "-and-size-" + minLA.ToString() + "-and-align-strength" + KGP.alignStrength.ToString() + ".txt");
            writer.write("C:/Users/afelder/Desktop/final/final-result-with-anisotropy-" + minSlender.ToString() + "-and-size-" + minLA.ToString() + "-and-align-strength-" + KGP.alignStrength.ToString() + ".txt", results);
          }
          numberOfTestedSolutions++;
        }
      }
    }

    centres = Gen.GetCentres();
    LA = Gen.GetLongAxes();
    SA = Gen.GetShortAxes();
    Lines = Gen.GetLines();
    testedSolutions = numberOfTestedSolutions;
    done = foundValidSolution;
    currentIteration = Gen.GetCount();
    currentRound = round;
    currentAnisotropy = minSlender;
# ---------- example_script_for_magpie: C# additional code ----------
  MechanoAdaptiveGeneration.Generator Gen;
  MechanoAdaptiveGeneration.AlgorithmConvergenceParameters ACP;
  MechanoAdaptiveGeneration.KangarooGoalParameters KGP;
  MechanoAdaptiveGeneration.InputGeometryParameters IGP;
  MechanoAdaptiveGeneration.EllipsoidParameters EP;
  MechanoAdaptiveGeneration.MagpieResults results;

  bool foundValidSolution;
  int numberOfTestedSolutions;
  bool tryNextSolution;
  int nParticles;
  int seed;

  double minLA;
  double maxLA;
  double minSlender;
  int round;

  public List<Point3d> populateMesh(Mesh mesh, int N, int seed){
    Vector3d diagonal = mesh.GetBoundingBox(true).Diagonal;
    Point3d diagonalStart = mesh.GetBoundingBox(true).Corner(true, true, true);
    List<Point3d> startingPoints = new List<Point3d>();
    Random random = new Random(seed);
    for(int i = 0;i < N;i++){
      double x = diagonalStart.X + random.NextDouble() * (diagonal.X);
      double y = diagonalStart.Y + random.NextDouble() * (diagonal.Y);
      double z = diagonalStart.Z + random.NextDouble() * (diagonal.Z);
      startingPoints.Add(new Point3d(x, y, z));
    }
    return startingPoints;
  }
# ---------- end example_script_for_magpie ----------
visualiseellipsoids_2 = VisualiseEllipsoids(pts=example_script_for_magpie.centres, longaxes=example_script_for_magpie.LA, shortaxes=example_script_for_magpie.SA)
colourful_2 = Colourful(geo=visualiseellipsoids_2)

# ----
# Read your Magpie results for postprocessing
button = Button()  # disabled
path_2 = FilePath("S:\04_Development\Magpie-beta\magpie-example-results\result-of-compiled-magpie.txt")  # disabled
openmagpieresults = MagpieReader(Read=button, InputFilePath=path_2)  # -> EllipsoidCentres, LongAxes, ShortAxes, CollisionLines, PlasticDragDistance, BoundaryCollideStrength, AlignStrength, FixedPointIndices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; disabled
shift_x = ShiftX(G=openmagpieresults.EllipsoidCentres, C=openmagpieresults.InputMesh)  # disabled
visualiseellipsoids_3 = VisualiseEllipsoids(pts=shift_x, longaxes=openmagpieresults.LongAxes, shortaxes=openmagpieresults.ShortAxes)  # disabled
line_2 = Line(openmagpieresults.CollisionLines)  # disabled
colourful_3 = Colourful(geo=visualiseellipsoids_3)  # disabled

panel = Panel(example_script_for_magpie.currentIteration)
iterations_performed = Panel(generate.Iterations)  # disabled
rec = DataRecorder(example_script_for_magpie.out, DataLimit=-10, RecordData=True)
avr = Average(Input=generate.RecentErrors)  # disabled
rec_2 = DataRecorder(avr, DataLimit=-10, RecordData=True)  # disabled
graph = QuickGraph(rec_2)  # disabled
subtraction = Subtraction(A=generate.RecentErrors, B=avr)  # disabled
sort = SortList(Keys=rec_2)  # -> Keys, ValuesA; disabled
graph_2 = QuickGraph(sort.Keys)  # disabled
division = Division(A=subtraction, B=avr)  # disabled
abs = Absolute(Value=division)  # disabled
avr_2 = Average(Input=abs)  # disabled
rec_3 = DataRecorder(avr_2, DataLimit=-10, RecordData=True)  # disabled
sort_2 = SortList(Keys=rec_3)  # -> Keys, ValuesA; disabled
graph_3 = QuickGraph(sort_2.Keys)  # disabled
item_3 = ListItem(List=sort_2.Keys, Index=0, Wrap=True)  # disabled
rec_4 = DataRecorder(item_3, DataLimit=-10, RecordData=True)  # disabled
graph_4 = QuickGraph(rec_4)  # disabled

# ==== cluster Colourful: Display objects in bright colours
geo = ClusterInput()
geo_2 = Geometry(geo)
clean = CleanTree(RemoveNulls=True, RemoveInvalid=True, RemoveEmpty=False, Tree=flatten(geo_2))
S = Shader([{ambient=RGB(128, 128, 128), diffuse=RGB(11, 125, 222), emission=RGB(3, 38, 67), shine=0.5, specular=RGB(255, 255, 255), transparency=0}, {ambient=RGB(128, 128, 128), diffuse=RGB(222, 37, 11), emission=RGB(67, 11, 3), shine=0.5, specular=RGB(255, 255, 255), transparency=0}, {ambient=RGB(128, 128, 128), diffuse=RGB(71, 222, 11), emission=RGB(21, 67, 3), shine=0.5, specular=RGB(255, 255, 255), transparency=0}, {ambient=RGB(128, 128, 128), diffuse=RGB(222, 194, 11), emission=RGB(67, 58, 3), shine=0.5, specular=RGB(255, 255, 255), transparency=0}])
lng = ListLength(List=clean)
repeat = RepeatData(Data=S, Length=lng)
preview = CustomPreview(Geometry=clean, Shader=repeat)

# ==== cluster VisualiseEllipsoids
pts = ClusterInput()
longaxes = ClusterInput()
shortaxes = ClusterInput()
ellipsoid_transforms = CSharpScript(Pts=pts, longAxes=longaxes, shortAxes=shortaxes)  # -> out, A; inputs Pts: list of Point3d, longAxes: list of Vector3d, shortAxes: list of Vector3d
# ---------- ellipsoid_transforms: C# ----------
    int count = Pts.Count();

    List<Transform> transforms = new List<Transform>();

    for(int i = 0; i < count; i++){
      Transform t = new Transform(1.0);

      t.M03 = Pts[i].X;
      t.M13 = Pts[i].Y;
      t.M23 = Pts[i].Z;

      t.M00 = longAxes[i][0];
      t.M10 = longAxes[i][1];
      t.M20 = longAxes[i][2];

      t.M01 = shortAxes[i][0];
      t.M11 = shortAxes[i][1];
      t.M21 = shortAxes[i][2];

      double la = longAxes[i].Length;
      double sa = shortAxes[i].Length;
      Vector3d xprod = Vector3d.CrossProduct(longAxes[i], shortAxes[i]);
      xprod.Unitize();

      t.M02 = sa * xprod[0];
      t.M12 = sa * xprod[1];
      t.M22 = sa * xprod[2];

      transforms.Add(t);
    }
    A = transforms;
# ---------- end ellipsoid_transforms ----------
msphere = MeshSphere(Base=PlaneXY(0, 0, 0), Radius=1, UCount=9, VCount=12)
transform = Transform(Geometry=msphere, Transform=ellipsoid_transforms.A)
G = ClusterOutput(transform)

# ==== cluster ShiftX
C = ClusterInput()
bbox = BoundingBox(Content=C, Plane=PlaneXY(0, 0, 0))  # -> Box, Box_2
boxprop = BoxProperties(Box=bbox.Box)  # -> Center, Diagonal, Area, Volume, Degeneracy
devec = DeconstructVector(Vector=boxprop.Diagonal)  # -> XComponent, YComponent, ZComponent
multiplication = Multiplication(A=devec.XComponent, B=2)
vec = VectorXYZ(XComponent=multiplication, YComponent=0, ZComponent=0)  # -> Vector, Length
G = ClusterInput()
move = Move(Geometry=G, Motion=vec.Vector)  # -> Geometry, Transform
G_2 = ClusterOutput(move.Geometry)
